# Grasshopper definition Pu.gh (Grasshopper 0.9.76)
# plug-ins: Python Interpreter, VirtualWindTunnel

# 40
# 40
number_slider = Slider(0.066, range=0..0.1)  # disabled
# zCells
# take2
# 10
# 10
number_slider_2 = Slider(0.264, range=0..1)  # disabled
# 20
# 20
number_slider_3 = Slider(0.132, range=0..1)  # disabled
# 80
number_slider_4 = Slider(0.033, range=0..0.1)  # disabled
number_slider_5 = Slider(2, range=0..10)  # disabled
number_slider_6 = Slider(2, range=0..10)  # disabled
number_slider_7 = Slider(3, range=0..10)  # disabled
# 40
number_slider_8 = Slider(0.332, range=0..0.4)
# 10
number_slider_9 = Slider(0.332, range=0..1)
# 20
number_slider_10 = Slider(0.132, range=0..1)  # disabled
# 80
number_slider_11 = Slider(0.033, range=0..0.1)  # disabled
number_slider_12 = Slider(4, range=0..10)
number_slider_13 = Slider(3, range=0..10)
number_slider_14 = Slider(2, range=0..10)
number_slider_15 = Slider(3, range=0..10)
number_slider_16 = Slider(2, range=0..10)
number_slider_17 = Slider(20, range=0..100)
number_slider_18 = Slider(3, range=0..10)
number_slider_19 = Slider(10000, range=0..10000)
wind_dir = ControlKnob(Decimals=0, Limit=True, Maximum=359, Minimum=0, Range=360, Value=0)
number_slider_20 = Slider(1.37, range=0..5)
abl = ABL(
    Uref=wind_dir,
    Zref=Slider(12, range=0..100),
    Z0=Slider(0.5, range=0..100),
    ZGround=Slider(0.005, range=0..100),
    ZGround_2=Slider(0, range=0..100))
panel = Panel("C:\MeshingPaper\Pu\")
number_slider_21 = Slider(21, range=0..150)  # disabled
panel_2 = Panel("C:\MeshingPaper\take2\cyl\normal\")
panel_3 = Panel("C:\MeshingPaper\take2\cyl\very_coarse\")
panel_4 = Panel("C:\MeshingPaper\take2\cyl\coarse\")
panel_5 = Panel("C:\MeshingPaper\take2\cyl\fine\")
number_slider_22 = Slider(48, range=1..100)
number_slider_23 = Slider(29, range=1..100)
multiplication = Multiplication(A=number_slider_23, B="2")
multiplication_2 = Multiplication(A=multiplication, B="2")
multiplication_3 = Multiplication(A=multiplication_2, B="2")
number_slider_24 = Slider(1.38, range=0..5)
number_slider_25 = Slider(96, range=1..200)
number_slider_26 = Slider(1.38, range=0..5)
number_slider_27 = Slider(1.38, range=0..5)
number_slider_28 = Slider(1, range=0..1)
number_slider_29 = Slider(1, range=0..1)
number_slider_30 = Slider(1, range=0..1)
toggle = BooleanToggle(True)
number_slider_31 = Slider(1, range=0..1)
toggle_2 = BooleanToggle(True)
toggle_3 = BooleanToggle(True)
number_slider_32 = Slider(0.444, range=0..10)  # disabled
toggle_4 = BooleanToggle(True)
geo = Geometry(<mesh referenced from the Rhino model>)
geo_2 = Geometry(<mesh referenced from the Rhino model>)
geo_3 = Geometry(<mesh referenced from the Rhino model>)
geo_4 = Geometry(<mesh referenced from the Rhino model>)
pt = Point(<point referenced from the Rhino model>)
pt_2 = Point(<point referenced from the Rhino model>)
pt_3 = Point(<point referenced from the Rhino model>)
pt_4 = Point(<point referenced from the Rhino model>)
domaincyl = DomainCyl(
    Geometry=geo,
    Directory=panel_2,
    WindDir=abl,
    DivisionsOuterCirc=multiplication_2,
    ScaleInnerR=number_slider_20,
    RAM=number_slider_28,
    CPUs=number_slider_28,
    Run=toggle)  # -> Out, Domain, Cyl
python = PythonScript(x=domaincyl.Domain)  # -> out, a
# ---------- python: Python ----------
x.BCInflow.flowDir;
# ---------- end python ----------
vdis = VectorDisplay(Anchor=pt, Vector=python.a)
domaincyl_2 = DomainCyl(
    Geometry=geo_3,
    Directory=panel_4,
    WindDir=abl,
    DivisionsOuterCirc=multiplication,
    ScaleInnerR=number_slider_20,
    RAM=number_slider_31,
    CPUs=number_slider_31,
    Run=toggle_4)  # -> Out, Domain, Cyl
python_2 = PythonScript(x=domaincyl_2.Domain)  # -> out, a; same code as python
vdis_2 = VectorDisplay(Anchor=pt_3, Vector=python_2.a)
domaincyl_3 = DomainCyl(
    Geometry=geo_2,
    Directory=panel_3,
    WindDir=abl,
    DivisionsOuterCirc=number_slider_23,
    DivisionsZ=Slider(0, range=0..1),
    ScaleInnerR=number_slider_20,
    RAM=number_slider_29,
    CPUs=number_slider_29,
    Run=toggle_3)  # -> Out, Domain, Cyl
python_3 = PythonScript(x=domaincyl_3.Domain)  # -> out, a, b; disabled
# ---------- python_3: Python ----------
a = x.radius;
b = x.center;
# ---------- end python_3 ----------
c_script = CSharpScript(
    center=python_3.b,
    sizeInnerRect=Slider(1.38, range=0..5),
    divisions=number_slider_23,
    circleRadius=python_3.a,
    windDir=wind_dir)  # -> out, A, B, C, D, E, F; inputs center: Point3d, sizeInnerRect: Double, divisions: Int32, circleRadius: Double, windDir: Double; disabled
# ---------- c_script: C# ----------
    List<Point3d> pointsOnCircle = new List<Point3d>();
    var pl = new Plane(center, Vector3d.ZAxis);
    var h = 10;
    var xinter = new Interval(-sizeInnerRect, sizeInnerRect);

    var m = Mesh.CreateFromPlane(pl, xinter, xinter, divisions, divisions); // creates the inner rectangle with arbitrary subdivision

    double minRad = Math.Sqrt(2 * (sizeInnerRect * sizeInnerRect));
    double circRad = circleRadius;
    if (circleRadius < minRad) circRad = minRad;

    var c = new Circle(center, circRad);

    var poly = m.GetNakedEdges()[0]; //returns a polygon with line segments for each mesh cell

    for (int i = 0; i < poly.Count; i++)
    {
      var vec = center - poly[i];
      vec.Unitize();
      vec *= (circleRadius + 1);
      double t1;
      double t2;
      Point3d p1;
      Point3d p2;
      var inter = Rhino.Geometry.Intersect.Intersection.LineCircle(new Line(center, vec), c, out t1, out p1, out t2, out p2);
      //if(inter == LineCircleIntersection.Single)
      pointsOnCircle.Add(p1);
    }

    var core = new Mesh();
    core.Append(m);
    core.Flip(true, true, true);

    var coreTop = new Mesh();
    coreTop.Append(m);
    coreTop.Translate(Vector3d.ZAxis * h);



    var perim = PerimeterRing(poly, pointsOnCircle);
    var perimTop = new Mesh();
    perimTop.Append(perim);
    perimTop.Translate(Vector3d.ZAxis * h);
    perimTop.Flip(true, true, true);




    var side = SideWalls(pointsOnCircle, h);
    //  B = side;

    var outMesh = new Mesh();
    outMesh.Append(perim);
    outMesh.Append(core);
    outMesh.Append(perimTop);
    outMesh.Append(coreTop);
    outMesh.Append(side);
    Print(outMesh.Vertices.Count.ToString());
    outMesh.Weld(0.00001);
    A = outMesh;
    B = perim;
    C = core;

    D = side;








    // D =

    //  D = stringifyBlocks(perim, core, perimTop, coreTop, 5, 10);
    //E = stringyfyVertexList(outMesh);
    // F = stringifyPatches(outMesh);
# ---------- c_script: C# additional code ----------
  public Mesh SideWalls(List < Point3d > pt, double h){

    int vcount = 0;
    var m = new Mesh();
    for (int i = 0; i < pt.Count - 1; i++)
    {
      m.Vertices.Add(pt[i]);
      m.Vertices.Add(pt[i] + Vector3d.ZAxis * h);
      m.Vertices.Add(pt[i + 1] + Vector3d.ZAxis * h);
      m.Vertices.Add(pt[i + 1]);

      m.Faces.AddFace(new MeshFace(vcount, vcount + 1, vcount + 2, vcount + 3));
      vcount += 4;
    }
    return m;
  }

  public Mesh PerimeterRing(Polyline poly, List<Point3d> pointsOnCircle){
    var mOutBottom = new Mesh();
    int vcount = 0;
    for (int i = 0; i < poly.Count - 1; i++)
    {
      mOutBottom.Vertices.Add(poly[i]);
      mOutBottom.Vertices.Add(pointsOnCircle[i]);
      mOutBottom.Vertices.Add(pointsOnCircle[i + 1]);
      mOutBottom.Vertices.Add(poly[i + 1]);

      mOutBottom.Faces.AddFace(new MeshFace(vcount, vcount + 1, vcount + 2, vcount + 3));
      vcount += 4;
    }
    return mOutBottom;
  }

  public string stringifyBlocks (Mesh perim, Mesh core, Mesh perimTop, Mesh coreTop, int divY, int divZ){
    System.Text.StringBuilder sb = new System.Text.StringBuilder();

    int counter = perim.Faces.Count + core.Faces.Count + perimTop.Faces.Count;

    for (int i = 0; i < core.Faces.Count; i++){
      sb.AppendLine("hex (" + core.Faces[i].A + " " + core.Faces[i].B + " " + core.Faces[i].C + " " + core.Faces[i].D + " " + ((coreTop.Faces[i].A + counter)) + " " + (coreTop.Faces[i].B + counter) + " " + (coreTop.Faces[i].C + counter) + " " + (coreTop.Faces[i].D + counter) + ") (1 " + divY + " " + divZ + ") simpleGrading (1 1 1)");
    }
    return sb.ToString();
  }

  public string stringifyPatches (Mesh outMesh){
    System.Text.StringBuilder sb = new System.Text.StringBuilder();
    for (int i = 0; i < outMesh.Faces.Count; i++){
      sb.AppendLine("patch" + i +@"
        {
        type patch;
        faces
        (");
      sb.AppendLine("(" + outMesh.Faces[i].A + " " + +outMesh.Faces[i].B + " " + outMesh.Faces[i].C + " " + outMesh.Faces[i].D + ")");
      sb.AppendLine(@");
        }");
    }


    return sb.ToString();
  }

  private static string stringyfyVertexList(Mesh outMesh)
  {
    System.Text.StringBuilder stb = new System.Text.StringBuilder();

    for (int i = 0; i < outMesh.Vertices.Count; i++)
    {
      stb.AppendLine("(" + outMesh.Vertices[i].X + " " + +outMesh.Vertices[i].Y + " " + +outMesh.Vertices[i].Z + ")");
    }
    return stb.ToString();
  }

  private int RoundToNearest5(double _Knob)
  {
    double Knob = _Knob;
    if (Knob < 0) Knob = 0;
    if (Knob > 359) Knob = 359;

    int flowDir = 0;
    while (Knob < 358)
    {
      if (Knob % 5 == 0)
      {
        flowDir = (int) Knob;
      }
      if (Knob % 5 == 1)
      {
        flowDir = (int) Knob - 1;
      }
      if (Knob % 5 == 2)
      {
        flowDir = (int) Knob - 2;
      }
      if (Knob % 5 == 3)
      {
        flowDir = (int) Knob + 2;
      }
      if (Knob % 5 == 4)
      {
        flowDir = (int) Knob + 1;
      }
      break;
    }
    if (Knob == 358 | Knob == 359)
    {
      flowDir = 0;
    }
    return flowDir;
  }
# ---------- end c_script ----------
panel_6 = Panel(c_script.out)  # disabled
demesh = DeconstructMesh(Mesh=c_script.A)  # -> Vertices, Faces, Colours, Normals; disabled
c_script_2 = CSharpScript(m=c_script.A, divs=number_slider_23)  # -> out, A; inputs m: Mesh, n: Mesh, divs: Int32; disabled
# ---------- c_script_2: C# ----------
    m.Append(n);
    //for (int i = 2; i < m.Vertices.Count; i++){
    m.Faces.AddFace(1, 2, 66, 65);

    A = m;
    //return mOutBottom;
# ---------- end c_script_2 ----------
face = MeshFace(demesh.Faces)  # disabled
item = ListItem(List=demesh.Vertices, Index=number_slider_21, Wrap=True)  # disabled
panel_7 = Panel(c_script.D)  # disabled
panel_8 = Panel(c_script.E)  # disabled
points = PointList(Points=demesh.Vertices, Size=number_slider_32)  # disabled
python_4 = PythonScript(x=domaincyl_3.Domain)  # -> out, a; same code as python
vdis_3 = VectorDisplay(Anchor=pt_2, Vector=python_4.a)
python_5 = PythonScript(x=domaincyl_3.Domain)  # -> out, a, b
# ---------- python_5: Python ----------
b = x.DomainMesh.Vertices;
# ---------- end python_5 ----------
domaincyl_4 = DomainCyl(
    Geometry=geo_4,
    Directory=panel_5,
    WindDir=abl,
    DivisionsOuterCirc=multiplication_3,
    ScaleInnerR=number_slider_20,
    RAM=number_slider_30,
    CPUs=number_slider_30,
    Run=toggle_2)  # -> Out, Domain, Cyl
python_6 = PythonScript(x=domaincyl_4.Domain)  # -> out, a; same code as python
vdis_4 = VectorDisplay(Anchor=pt_4, Vector=python_6.a)
item_2 = ListItem(List=python_5.b, Index=Slider(41, range=0..50), Wrap=True)
clean = Clean(Dir=panel_2, Run=Button())
clean_2 = Clean(Dir=panel_3, Run=Button())
clean_3 = Clean(Dir=panel_4, Run=Button())
clean_4 = Clean(Dir=panel_5, Run=Button())
points_2 = PointList(Points=item_2)
cluster = Cluster_2(x=domaincyl_3.Domain)  # -> a, A
panel_9 = Panel(cluster.a)
# Cyl
# layers variable
panel_10 = Panel(cluster.A)
python_7 = PythonScript(x=domaincyl_3.Domain)  # -> out, a; same code as python
# zCells
cluster_2 = Cluster(x=domaincyl_3.Domain)
panel_11 = Panel(python_7.a)
cellsize = CellSize(Domain=domaincyl.Domain, BlockMeshCellSize=panel_11, DesiredCellSize="0.025")
cellsize_2 = CellSize(Domain=domaincyl_3.Domain, BlockMeshCellSize=panel_11, DesiredCellSize="0.025")
cellsize_3 = CellSize(Domain=domaincyl_2.Domain, BlockMeshCellSize=panel_11, DesiredCellSize="0.025")
cellsize_4 = CellSize(Domain=domaincyl_4.Domain, BlockMeshCellSize=panel_11, DesiredCellSize="0.025")
panel_12 = Panel(cluster_2)
mesh = Mesh(
    Domain=domaincyl_3.Domain,
    AccBuilding=number_slider_14,
    AccFeatures=number_slider_16,
    AccRefinement=number_slider_13,
    AccGround=number_slider_15,
    Layer=number_slider_18,
    Run=toggle_3)  # -> Out, Domain
demesh_2 = DeconstructMesh(Mesh=cluster.a)  # -> Vertices, Faces, Colours, Normals
mesh_2 = Mesh(
    Domain=domaincyl_4.Domain,
    AccBuilding=number_slider_14,
    AccFeatures=number_slider_16,
    AccRefinement=number_slider_13,
    AccGround=number_slider_15,
    Layer=number_slider_18,
    Run=toggle_3)  # -> Out, Domain
mesh_3 = Mesh(
    Domain=domaincyl.Domain,
    AccBuilding=number_slider_14,
    AccFeatures=number_slider_16,
    AccRefinement=number_slider_13,
    AccGround=number_slider_15,
    Layer=number_slider_18,
    Run=toggle_3)  # -> Out, Domain
mesh_4 = Mesh(
    Domain=domaincyl_2.Domain,
    AccBuilding=number_slider_14,
    AccFeatures=number_slider_16,
    AccRefinement=number_slider_13,
    AccGround=number_slider_15,
    Layer=number_slider_18,
    Run=toggle_3)  # -> Out, Domain
item_3 = ListItem(List=demesh_2.Faces, Index=Slider(31, range=0..60), Wrap=True)
crv = Curve(<curve referenced from the Rhino model>)
face_2 = MeshFace(item_3)
crv_2 = Curve(<curve referenced from the Rhino model>)
crv_3 = Curve(<curve referenced from the Rhino model>)
divide = DivideCurve(Curve=crv, Count=Slider(50, range=0..100), Kinks=False)  # -> Points, Tangents, Parameters
crv_4 = Curve(<curve referenced from the Rhino model>)
divide_2 = DivideCurve(Curve=crv_2, Count=Slider(50, range=0..100), Kinks=False)  # -> Points, Tangents, Parameters
divide_3 = DivideCurve(Curve=crv_3, Count=Slider(50, range=0..100), Kinks=False)  # -> Points, Tangents, Parameters
number_slider_33 = Slider(0.01, range=0..1)
divide_4 = DivideCurve(Curve=crv_4, Count=Slider(50, range=0..100), Kinks=False)  # -> Points, Tangents, Parameters
probes = Probes(Domain=domaincyl_3.Domain, Points=divide.Points, PointName=1, Run=Toggle(False))
gradient = Gradient(
    LowerLimit=Slider(0, range=0..10),
    UpperLimit=Slider(13, range=0..25),
    Parameter=probes,
    stops=[0: RGB(0, 128, 0), 0.5: RGB(255, 255, 0), 1: RGB(255, 0, 0)])
probes_2 = Probes(Domain=domaincyl_2.Domain, Points=divide_2.Points, PointName=1, Run=Toggle(False))
gradient_2 = Gradient(
    LowerLimit=Slider(0, range=0..10),
    UpperLimit=Slider(13, range=0..25),
    Parameter=probes_2,
    stops=[0: RGB(0, 128, 0), 0.5: RGB(255, 255, 0), 1: RGB(255, 0, 0)])
probes_3 = Probes(Points=divide_3.Points, PointName=1, Run=Toggle(False))
gradient_3 = Gradient(
    LowerLimit=Slider(0, range=0..10),
    UpperLimit=Slider(13, range=0..25),
    Parameter=probes_3,
    stops=[0: RGB(0, 128, 0), 0.5: RGB(255, 255, 0), 1: RGB(255, 0, 0)])
simulation = Simulation(
    Domain=mesh_3.Domain,
    Iterations=number_slider_19,
    WriteInterval=number_slider_17,
    KeepTimeSteps=number_slider_12,
    Mode=0,
    Bcond=toggle)
residualwriter = ResidualWriter(WorkingDir=panel_2, Mode=0)  # disabled
simulation_2 = Simulation(
    Domain=mesh.Domain,
    Iterations=number_slider_19,
    WriteInterval=number_slider_17,
    KeepTimeSteps=number_slider_12,
    Mode=0,
    Bcond=toggle_3)
residualwriter_2 = ResidualWriter(WorkingDir=panel_3, Mode=0)  # disabled
multiplication_4 = Multiplication(A=probes, B=number_slider_33)
probes_4 = Probes(Points=divide_4.Points, PointName=1, Run=Toggle(False))
simulation_3 = Simulation(
    Domain=mesh_4.Domain,
    Iterations=number_slider_19,
    WriteInterval=number_slider_17,
    KeepTimeSteps=number_slider_12,
    Mode=0,
    Bcond=toggle_4)
residualwriter_3 = ResidualWriter(WorkingDir=panel_4, Mode=0)  # disabled
gradient_4 = Gradient(
    LowerLimit=Slider(0, range=0..10),
    UpperLimit=Slider(13, range=0..25),
    Parameter=probes_4,
    stops=[0: RGB(0, 128, 0), 0.5: RGB(255, 255, 0), 1: RGB(255, 0, 0)])
simulation_4 = Simulation(
    Domain=mesh_2.Domain,
    Iterations=number_slider_19,
    WriteInterval=number_slider_17,
    KeepTimeSteps=number_slider_12,
    Mode=0,
    Bcond=toggle_2)
residualwriter_4 = ResidualWriter(WorkingDir=panel_5, Mode=0)  # disabled
vdisex = VectorDisplayEx(Point=divide.Points, Vector=multiplication_4, Colour=gradient, Width=2)
vdisex_2 = VectorDisplayEx(Point=divide.Points, Vector=multiplication_4, Colour=gradient, Width=2)
vdisex_3 = VectorDisplayEx(Point=divide.Points, Vector=multiplication_4, Colour=gradient, Width=2)
multiplication_5 = Multiplication(A=probes_2, B=Slider(0.01, range=0..1))
vdisex_4 = VectorDisplayEx(Point=divide.Points, Vector=multiplication_4, Colour=gradient, Width=2)
multiplication_6 = Multiplication(A=probes_3, B=Slider(0.01, range=0..1))
multiplication_7 = Multiplication(A=probes_4, B=Slider(0.01, range=0..1))
number_slider_34 = Slider(2, range=1..3)
number_slider_35 = Slider(2, range=1..3)
number_slider_36 = Slider(2, range=1..3)
number_slider_37 = Slider(3, range=1..3)
number_slider_38 = Slider(3, range=1..3)
toggle_5 = BooleanToggle(True)
toggle_6 = BooleanToggle(True)
panel_13 = Panel("C:\MeshingPaper\take2\box\fine\")
panel_14 = Panel("C:\MeshingPaper\take2\box\normal\")
panel_15 = Panel("C:\MeshingPaper\take2\box\coarse\")
panel_16 = Panel("C:\MeshingPaper\take2\box\very_coarse\")
division = Division(A="0.095", B="2")
geo_5 = Geometry(<mesh referenced from the Rhino model>)
panel_17 = Panel("1")
toggle_7 = BooleanToggle(True)
toggle_8 = BooleanToggle(True)
num = Number("1")
geo_6 = Geometry(<mesh referenced from the Rhino model>)
geo_7 = Geometry(<mesh referenced from the Rhino model>)
num_2 = Number(division)
division_2 = Division(A=num_2, B="2")
num_3 = Number(division_2)
division_3 = Division(A=num_3, B="2")
num_4 = Number(division_3)
clean_5 = Clean(Dir=panel_16, Run=Button())
toggle_9 = BooleanToggle(True)
num_5 = Number("1")
geo_8 = Geometry(<mesh referenced from the Rhino model>)
clean_6 = Clean(Dir=panel_15, Run=Button())
# Box
domainbox = DomainBox(Geometry=geo_5, Directory=panel_16, BCond=abl, BaseMesh="0.095", RAM=num, CPUs=1, Run=toggle_6)  # -> Out, Domain, Cyl, D, E
domainbox_2 = DomainBox(Geometry=geo_6, Directory=panel_15, BaseMesh=abl, RAM=num_2, CPUs=num_2, Run_2=toggle_5)  # -> Out, Domain, Cyl, D, E
domainbox_3 = DomainBox(Geometry=geo_7, Directory=panel_14, BaseMesh=abl, RAM="0.025", CPUs=num_3, Run=toggle_5, Run_2=toggle_5)  # -> Out, Domain, Cyl, D, E
num_6 = Number("1")
clean_7 = Clean(Dir=panel_14, Run=Button())
domainbox_4 = DomainBox(Geometry=geo_8, Directory=panel_13, BaseMesh=abl, RAM=num_4, CPUs=num_6, Run=toggle_5, Run_2=toggle_5)  # -> Out, Domain, Cyl, D, E
clean_8 = Clean(Dir=panel_13, Run=Button())
panel_18 = Panel("2")
panel_19 = Panel("3")
mesh_5 = Mesh(
    Domain=domainbox.Domain,
    AccBuilding=number_slider_34,
    AccFeatures=number_slider_35,
    AccRefinement=number_slider_37,
    AccGround=number_slider_36,
    Layer=number_slider_38,
    Run=toggle_6)  # -> Out, Domain
mesh_6 = Mesh(
    Domain=domainbox_2.Domain,
    AccBuilding=number_slider_34,
    AccFeatures=number_slider_35,
    AccRefinement=number_slider_37,
    AccGround=number_slider_36,
    Layer=number_slider_38,
    Run=toggle_6)  # -> Out, Domain
mesh_7 = Mesh(
    Domain=domainbox_3.Domain,
    AccBuilding=number_slider_34,
    AccFeatures=number_slider_35,
    AccRefinement=number_slider_37,
    AccGround=number_slider_36,
    Layer=number_slider_38,
    Run=toggle_6)  # -> Out, Domain
mesh_8 = Mesh(
    Domain=domainbox_4.Domain,
    AccBuilding=number_slider_34,
    AccFeatures=number_slider_35,
    AccRefinement=number_slider_37,
    AccGround=number_slider_36,
    Layer=number_slider_38,
    Run=toggle_6)  # -> Out, Domain
crv_5 = Curve(<curve referenced from the Rhino model>)
divide_5 = DivideCurve(Curve=crv_5, Count=Slider(50, range=0..100), Kinks=False)  # -> Points, Tangents, Parameters
simulation_5 = Simulation(
    Domain=mesh_6.Domain,
    Iterations=Slider(10000, range=0..10000),
    WriteInterval=Slider(20, range=0..100),
    KeepTimeSteps=Slider(4, range=0..10),
    Mode=0,
    Bcond=toggle_5)
simulation_6 = Simulation(
    Domain=mesh_5.Domain,
    Iterations=Slider(10000, range=0..10000),
    WriteInterval=Slider(20, range=0..100),
    KeepTimeSteps=Slider(4, range=0..10),
    Mode=0,
    Bcond=toggle_6)
residualwriter_5 = ResidualWriter(WorkingDir=panel_16, Mode=0)  # disabled
simulation_7 = Simulation(
    Domain=mesh_7.Domain,
    Iterations=Slider(10000, range=0..10000),
    WriteInterval=Slider(26, range=0..100),
    KeepTimeSteps=Slider(4, range=0..10),
    Mode=0,
    Bcond=toggle_5)
number_slider_39 = Slider(0.029, range=0..1)
residualwriter_6 = ResidualWriter(WorkingDir=panel_15, Mode=0)  # disabled
probes_5 = Probes(Domain=domainbox.Domain, Points=divide_5.Points, PointName=1, Run=Toggle(False))
gradient_5 = Gradient(
    LowerLimit=Slider(0, range=0..10),
    UpperLimit=Slider(13, range=0..25),
    Parameter=probes_5,
    stops=[0: RGB(0, 128, 0), 0.5: RGB(255, 255, 0), 1: RGB(255, 0, 0)])
residualwriter_7 = ResidualWriter(WorkingDir=panel_14, Mode=0)  # disabled
simulation_8 = Simulation(
    Domain=mesh_8.Domain,
    Iterations=Slider(10000, range=0..10000),
    WriteInterval=Slider(20, range=0..100),
    KeepTimeSteps=Slider(4, range=0..10),
    Mode=0,
    Bcond=toggle_5)
residualwriter_8 = ResidualWriter(WorkingDir=panel_13, Mode=0)  # disabled
multiplication_8 = Multiplication(A=probes_5, B=number_slider_33)
vdisex_5 = VectorDisplayEx(Point=divide_5.Points, Vector=multiplication_8, Colour=gradient_5, Width=2)

# ==== cluster Cluster
x = ClusterInput()
python = PythonScript(x=x)  # -> out, a
# ---------- python: Python ----------
a = x.cellSizeInner;
# ---------- end python ----------
division = Division(A="1.5", B=python.a)
round = Round(Number=division)  # -> Nearest, Floor, Ceiling
N = ClusterOutput(round.Nearest)

# ==== cluster Cluster_2
x = ClusterInput()
python = PythonScript(x=x)  # -> out, a
# ---------- python: Python ----------
a = x.side;
# ---------- end python ----------
c_script = CSharpScript(x=python.a)  # -> out, A; inputs x: Mesh
# ---------- c_script: C# ----------
    List < int > list = new List<int>();

    for (int i = 0; i < x.Faces.Count; i++){
      list.Add(x.Faces[i].A);
    }
    A = list;
# ---------- end c_script ----------
A = ClusterOutput(c_script.A)
a = ClusterOutput(python.a)
