# Grasshopper definition testFile.gh (Grasshopper 0.9.76)
# plug-ins: Python Interpreter, VirtualWindTunnel

number_slider = Slider(10, range=0..100)
button = Button()
brep = Brep(<brep referenced from the Rhino model>)
xz = XZPlane(Origin=Point(-0.0485980799, -4.042677826, 0))  # disabled
domain = Domain(
    Geometry=brep,
    Directory="C:\OF2\",
    Mode=number_slider,
    BaseMesh=number_slider,
    RAM=Slider(9288, range=0..64000),
    CPUs=Slider(1, range=1..8),
    Run=Toggle(False))  # -> Out, Domain, Cyl
c_script = CSharpScript(b=brep, p=xz)  # -> out, B, A; inputs b: list of Brep, p: Plane; disabled
# ---------- c_script: C# ----------
    double pj = 0;
    A = FindFacades(p, b, out pj);
    B = pj;
# ---------- c_script: C# additional code ----------
  static List<Brep> FindFacades(Plane plane, List<Brep> volumes, out double projectedAreaTotal)
  {
    List<Brep> Facades = new List<Brep>();

    List<double> projectedAreas = new List<double>();
    foreach (Brep b in volumes)
    {
      for (int i = 0; i < b.Faces.Count; i++)
      {
        Vector3d vSurf = b.Faces[i].NormalAt(0.5, 0.5);
        double dot = plane.ZAxis * vSurf;
        if (dot < 0.1) continue;


        Brep face = b.Faces[i].DuplicateFace(false);
        //Print(dot + "");
        Facades.Add(face);

        Vector3d cross = Vector3d.CrossProduct(plane.ZAxis, vSurf);
        double norm = cross.Length;
        double angle = Math.Atan2(norm, dot);

        //Print((angle * 180 / Math.PI) + "");

        double projectedArea = face.GetArea() * Math.Cos(angle);

        projectedAreas.Add(projectedArea);
        //Print(projectedArea + "");
      }
    }
    projectedAreaTotal = projectedAreas.Sum(x => x);

    return Facades;
  }
# ---------- end c_script ----------
panel = Panel(c_script.B)
python = PythonScript()  # -> out, a, b, c, d, e, f; disabled
# ---------- python: Python ----------
a=x.BBox
b=x.centerGroundBBox
c=x.BBox.Min
d=x.BBox.Max
e=x.dimY
f=x.newBoxDomain.GetCorners
# ---------- end python ----------
panel_2 = Panel(python.b)  # disabled
panel_3 = Panel(python.f)  # disabled
panel_4 = Panel(python.a)  # disabled
panel_5 = Panel(python.c)  # disabled
mesh = Mesh(Domain=domain.Domain, Accuracy=Slider(3, range=0..10), Run=Toggle(False))  # -> Out, Domain
gradient = Gradient(
    LowerLimit=0,
    UpperLimit=1,
    stops=[0: RGB(234, 38, 0), 0.25: RGB(234, 126, 0), 0.463: RGB(254, 244, 84), 0.75: RGB(173, 203, 249), 1: RGB(75, 107, 169)])
simulation = Simulation(
    Domain=mesh.Domain,
    Iterations=Slider(1000, range=0..1000),
    WriteInterval=Slider(20, range=0..100),
    KeepTimeSteps=Slider(5, range=0..10),
    Run=Toggle(False))
vdisex = VectorDisplayEx(Colour=gradient, Width=2)
number_slider_2 = Slider(697, range=1..2000)
pt = ConstructPoint(XCoordinate=0, YCoordinate=0, ZCoordinate=0)
multiplication = Multiplication(A=number_slider_2, B="0.5")
neg = Negative(Value=multiplication)
xy = XYPlane(Origin=pt)
dom = ConstructDomain(DomainStart=neg, DomainEnd=multiplication)
circle = CircleCNR(Center=pt, Normal=Vector(0, 0, 1), Radius=number_slider_2)
rectangle = Rectangle(Plane=xy, XSize=dom, YSize=dom, Radius=0)  # -> Rectangle, Length
Y = UnitY(Factor=number_slider_2)
move = Move(Geometry=pt, Motion=Y)  # -> Geometry, Transform
angle = Panel("5")
division = Division(A="360", B=angle)
number_slider_3 = Slider(0.4, range=0..100)
series = Series(Start=0, Step=angle, Count=division)
rad = Radians(Degrees=series)
# arcPoints0
rotate = Rotate(Geometry=move.Geometry, Angle=rad, Plane=xy)  # -> Geometry, Transform
ln = Line(StartPoint=pt, EndPoint=rotate.Geometry)
# boxPoints0
ccx = CurveCurve(CurveA=rectangle.Rectangle, CurveB=ln)  # -> flatten(Points), ParamsA, ParamsB
points = PointList(Points=ccx.Points, Size=number_slider_3)
points_2 = PointList(Points=rotate.Geometry, Size=number_slider_3)
panel_6 = Panel("""0
1
2
3
4
5
6
7
8
71
70
69
68
67
66
65
64""")
lng = ListLength(List=ccx.Points)
panel_7 = Panel("""36
35
34
33
32
31
30
29
28
37
38
39
40
41
42
43
44""")
panel_8 = Panel(series)
panel_9 = Panel("""62
61
60
59
58
57
56
55
54
53
52
51
50
49
48
47
46""")
panel_10 = Panel("""10
11
12
13
14
15
16
17
18
19
20
21
22
23
24
25
26""")
division_2 = Division(A=lng, B="2")
item = ListItem(List=ccx.Points, Index=panel_6, Wrap=True)
item_2 = ListItem(List=ccx.Points, Index=panel_7, Wrap=True)
item_3 = ListItem(List=ccx.Points, Index=panel_10, Wrap=True)
item_4 = ListItem(List=ccx.Points, Index=panel_9, Wrap=True)
ln_2 = Line(StartPoint=item_3, EndPoint=item_4)
ln_3 = Line(StartPoint=item, EndPoint=item_2)
crossref = CrossReference(ListA=ln_3, ListB=ln_2, CrossMode=1)  # -> ListA, ListB, ListC, ListD
# gridPoints0
ccx_2 = CurveCurve(CurveA=crossref.ListA, CurveB=crossref.ListB)  # -> flatten(Points), ParamsA, ParamsB
points_3 = PointList(Points=ccx_2.Points, Size=number_slider_3)
number_slider_4 = Slider(10, range=0..10)
# vertical displacement
Z = UnitZ(Factor=multiplication)
# 24
move_2 = Move(Geometry=ccx_2.Points, Motion=Z)  # -> Geometry, Transform
# gridPoints1
# 25
move_3 = Move(Geometry=rotate.Geometry, Motion=Z)  # -> Geometry, Transform
# boxPoints1
# 25
move_4 = Move(Geometry=ccx.Points, Motion=Z)  # -> Geometry, Transform
fulllist = CSharpScript(
    arcPoints0=rotate.Geometry,
    boxPoints0=ccx.Points,
    gridPoints0=ccx_2.Points,
    arcPoints1=move_3.Geometry,
    boxPoints1=move_4.Geometry,
    gridPoints1=move_2.Geometry)  # -> out, A, B; inputs arcPoints0: list of Point3d, boxPoints0: list of Point3d, gridPoints0: list of Point3d, arcPoints1: list of Point3d, boxPoints1: list of Point3d, gridPoints1: list of Point3d
# ---------- fulllist: C# ----------
    List<Point3d> L = new List<Point3d>();
    List<String> L2 = new List<String>();

    //L = arcPoints0.Concat(boxPoints0).Concat(gridPoints0).ToList();
    //L2 = arcPoints0.Concat(boxPoints0).Concat(gridPoints0).Concat(arcPoints1).Concat(boxPoints1).Concat(gridPoints1).ToList().GetRange(73, 73);
    L = arcPoints0.Concat(boxPoints0).Concat(gridPoints0).Concat(arcPoints1).Concat(boxPoints1).Concat(gridPoints1).ToList();
    //L = arcPoints0.Concat(boxPoints0).Concat(gridPoints0).ToList();

    A = L;
    //B = L2;


    for (int i = 0; i < L.Count ; i++){
      L2.Add("(" + L[i].X + " " + +L[i].Y + " " + +L[i].Z + ")");
    }
    B = L2;
# ---------- end fulllist ----------
points_4 = PointList(Points=fulllist.A, Size=number_slider_3)
panel_11 = Panel(fulllist.B)
# faces
# arcs
c_script_2 = CSharpScript(fullList=fulllist.A, divisionsX="1", divisionsY=Slider(5, range=0..10), divisionsZ=number_slider_4)  # -> out, A, B, C, D, E, F, G, AA; inputs fullList: list of Point3d, divisionsX: Int32, divisionsY: Int32, divisionsZ: Int32
# ---------- c_script_2: C# ----------
    Mesh m = new Mesh();
    Mesh n = new Mesh();
    List<String> L1 = new List<String>();
    List<String> L2 = new List<String>();
    List<String> L3 = new List<String>();
    List<String> listGround = new List<String>();
    List<String> listTop = new List<String>();

    foreach(Point3d xx in fullList) m.Vertices.Add(xx);


    for(int i = 0; i < fullList.Count / 12 - 1 ;i++){
      m.Faces.AddFace(i, i + 1, fullList.Count / 12 + i + 1, fullList.Count / 12 + i);
    }
    //last Face in list
    m.Faces.AddFace(fullList.Count / 12 - 1, 0, fullList.Count / 12, fullList.Count / 12 + fullList.Count / 12 - 1);

    for(int i = fullList.Count / 2; i < fullList.Count / 2 + fullList.Count / 12 - 1 ;i++){
      m.Faces.AddFace(i, i + 1, fullList.Count / 12 + i + 1, fullList.Count / 12 + i);
    }
    //last Face in list
    m.Faces.AddFace(fullList.Count / 2 + fullList.Count / 12 - 1, fullList.Count / 2, fullList.Count / 12 + fullList.Count / 2, fullList.Count / 2 + (2 * fullList.Count / 12) - 1);


    //arcPoints1.Count - 1


    A = m;

    for(int i = 0; i < fullList.Count / 12;i++){
      L1.Add(" hex (" + m.Faces[i].A.ToString() + " " + m.Faces[i].B.ToString() + " " + m.Faces[i].C.ToString() + " " + m.Faces[i].D.ToString() + " ");
    }
    //
    for(int i = fullList.Count / 12; i < fullList.Count / 6  ;i++){
      L2.Add(m.Faces[i].A.ToString() + " " + m.Faces[i].B.ToString() + " " + m.Faces[i].C.ToString() + " " + m.Faces[i].D.ToString() + ") (" + divisionsX + " " + divisionsY + " " + divisionsZ + ") simpleGrading (1 1 1) ");
    }

    // for(int i = 0; i < fullList.Count / 12;i++){
    //   L3.Add(m.Faces[i].A.ToString());
    //   L3.Add(m.Faces[i].B.ToString());
    //  L3.Add(m.Faces[i].C.ToString());
    //  L3.Add(m.Faces[i].D.ToString());
    // }

    listGround.Add("ground\n {\n type wall;\n faces\n (");
    for(int i = 0; i < fullList.Count / 12;i++){
      listGround.Add("(" + m.Faces[i].A.ToString() + " " + m.Faces[i].B.ToString() + " " + m.Faces[i].C.ToString() + " " + m.Faces[i].D.ToString() + ")");
    }
    //listGround.Add(" \n  );\n}");

    listTop.Add("top\n {\n type symmetry;\n faces\n (");
    for(int i = fullList.Count / 12; i < fullList.Count / 6  ;i++){
      listTop.Add("(" + m.Faces[i].A.ToString() + " " + m.Faces[i].B.ToString() + " " + m.Faces[i].C.ToString() + " " + m.Faces[i].D.ToString() + ")");
    }
    //listTop.Add(" \n  );\n}");

    C = L1;
    D = L2;
    E = L3;
    F = listGround;
    G = listTop;
# ---------- end c_script_2 ----------
points_5 = PointList(Points=move_2.Geometry, Size=number_slider_3)
points_6 = PointList(Points=move_4.Geometry, Size=number_slider_3)
points_7 = PointList(Points=move_3.Geometry, Size=number_slider_3)
reset = Button()
# vertices
concat = Concatenate(FragmentA=c_script_2.C, FragmentB=c_script_2.D)
wind_dir = ControlKnob(Decimals=0, Limit=True, Maximum=359, Minimum=0, Range=360, Value=0)
panel_12 = Panel(c_script_2.F)
panel_13 = Panel(c_script_2.G)
# blocks
# arc
panel_14 = Panel(concat)
panel_15 = Panel(c_script_2.C)
panel_16 = Panel("""True
True
True
True
True
True
True
True
True
True
True
True
True
True
True
True
True
True
False
False
False
False
False
False
False
False
False
False
False
False
False
False
False
False
False
False
False
False
False
False
False
False
False
False
False
False
False
False
False
False
False
False
False
False
True
True
True
True
True
True
True
True
True
True
True
True
True
True
True
True
True
True""")
c_script_3 = CSharpScript(arcPoints1=move_3.Geometry, boxPoints1=move_4.Geometry, gridPoints1=move_3.Geometry)  # -> out, A, B; inputs arcPoints1: list, boxPoints1: list, gridPoints1: list; disabled
# ---------- c_script_3: C# ----------
    Mesh m = new Mesh();
    Mesh n = new Mesh();


    //foreach(Point3d xx in arcPoints0) m.Vertices.Add(xx);
    //foreach(Point3d xx in boxPoints0) m.Vertices.Add(xx);
    //foreach(Point3d xx in gridPoints0) m.Vertices.Add(xx);
    foreach(Point3d xx in arcPoints1) n.Vertices.Add(xx);
    foreach(Point3d xx in boxPoints1) n.Vertices.Add(xx);
    foreach(Point3d xx in gridPoints1) n.Vertices.Add(xx);


    //for(int i = 0; i < arcPoints0.Count - 1 ;i++){
    //  m.Faces.AddFace(i, i + 1, arcPoints0.Count + i + 1, arcPoints0.Count + i);
    //}
    //last Face in list
    //m.Faces.AddFace(arcPoints0.Count - 1, 0, arcPoints0.Count, arcPoints0.Count + boxPoints0.Count - 1);

    for(int i = 0; i < arcPoints1.Count - 1;i++){
      n.Faces.AddFace(i, i + 1, arcPoints1.Count + i + 1, arcPoints1.Count + i);
    }
    n.Faces.AddFace(arcPoints1.Count - 1 , 0, arcPoints1.Count , arcPoints1.Count + boxPoints1.Count - 1 );


    //arcPoints1.Count - 1



    A = n;




    //for(int i = 0; i < m.Faces.Count;i++){
    //
    //  Print(m.Faces[i].A + " " + m.Faces[i].B + " " + m.Faces[i].C + " " + m.Faces[i].D + " ");

    //}
    for(int i = 0; i < n.Faces.Count;i++){

      Print(n.Faces[i].A + " " + n.Faces[i].B + " " + n.Faces[i].C + " " + n.Faces[i].D + " ");

    }
# ---------- end c_script_3 ----------
c_script_4 = CSharpScript(arcPoints1=rotate.Geometry, boxPoints1=ccx.Points, gridPoints1=ccx_2.Points)  # -> out, A, B; inputs arcPoints1: list, boxPoints1: list, gridPoints1: list; disabled
# ---------- c_script_4: C# ----------
    Mesh m = new Mesh();
    Mesh n = new Mesh();


    //foreach(Point3d xx in arcPoints0) m.Vertices.Add(xx);
    //foreach(Point3d xx in boxPoints0) m.Vertices.Add(xx);
    //foreach(Point3d xx in gridPoints0) m.Vertices.Add(xx);
    foreach(Point3d xx in arcPoints1) n.Vertices.Add(xx);
    foreach(Point3d xx in boxPoints1) n.Vertices.Add(xx);
    foreach(Point3d xx in gridPoints1) n.Vertices.Add(xx);


  

    for(int i = 0; i < boxPoints1.Count - 1;i++){
      n.Faces.AddFace(i, i + 1, arcPoints1.Count + i + 1, arcPoints1.Count + i);
    }
    n.Faces.AddFace(arcPoints1.Count - 1, 0, arcPoints1.Count, arcPoints1.Count + boxPoints1.Count - 1);


    //arcPoints1.Count - 1



    A = n;




    //for(int i = 0; i < m.Faces.Count;i++){
    //
    //  Print(m.Faces[i].A + " " + m.Faces[i].B + " " + m.Faces[i].C + " " + m.Faces[i].D + " ");

    //}
    for(int i = 0; i < n.Faces.Count;i++){

      Print(n.Faces[i].A + " " + n.Faces[i].B + " " + n.Faces[i].C + " " + n.Faces[i].D + " ");

    }
# ---------- end c_script_4 ----------
c_script_5 = CSharpScript(
    boxPoints0=ccx.Points,
    gridPoints0=ccx_2.Points,
    arcPoints1=move_3.Geometry,
    boxPoints1=move_4.Geometry,
    gridPoints1=move_2.Geometry)  # -> out, A, B; inputs arcPoints0: list of Point3d, boxPoints0: list of Point3d, gridPoints0: list of Point3d, arcPoints1: list of Point3d, boxPoints1: list of Point3d, gridPoints1: list of Point3d; disabled
# ---------- c_script_5: C# ----------
    List<Point3d> L = new List<Point3d>();
    List<Point3d> L2 = new List<Point3d>();



    L = boxPoints0.Concat(gridPoints0).Concat(boxPoints1).Concat(gridPoints1).ToList();
    //L2 = arcPoints0.Concat(boxPoints0).Concat(gridPoints0).Concat(arcPoints1).Concat(boxPoints1).Concat(gridPoints1).ToList().GetRange(73, 73);
    //L2 = boxPoints1.Concat(gridPoints1).ToList();
    A = L;
    B = L2;
# ---------- end c_script_5 ----------
# faces
# patches
c_script_6 = CSharpScript(fullList=fulllist.A, inletOutletCheck=panel_16)  # -> out, A, B, C, D; inputs fullList: list of Point3d, inletOutletCheck: list of String
# ---------- c_script_6: C# ----------
    Mesh m = new Mesh();
    //Mesh n = new Mesh();
    List<string> L1 = new List<String>();
    //List<string> inletOutletCheck = new List<String>();
    List<string> inletOutletList = new List<String>();
    // List<String> L2 = new List<String>();


    //foreach(Point3d xx in arcPoints0) m.Vertices.Add(xx);
    //foreach(Point3d xx in arcPoints1) m.Vertices.Add(xx);
    foreach(Point3d xx in fullList) m.Vertices.Add(xx);


    for(int i = 0; i < fullList.Count / 12 - 1 ;i++){
      m.Faces.AddFace(i, i + 1, fullList.Count / 2 + i + 1, fullList.Count / 2 + i);
    }
    //last Face in list
    m.Faces.AddFace(fullList.Count / 12 - 1, 0, fullList.Count / 2, fullList.Count / 2 + fullList.Count / 12 - 1);

    A = m;

    for(int i = 0; i < fullList.Count / 12 ;i++){
      if (inletOutletCheck[i] == "True"){
        inletOutletList.Add("inlet" + i);
      }
      else{
        inletOutletList.Add("outlet" + i);
      }
    }

    for(int i = 0; i < fullList.Count / 12 ;i++){
      L1.Add(inletOutletList[i] + "\n {\n type patch;\n faces\n (\n(\t" + m.Faces[i].A.ToString() + " " + m.Faces[i].B.ToString() + " " + m.Faces[i].C.ToString() + " " + m.Faces[i].D.ToString() + ") \n  );\n}");
    }


    D = inletOutletList;
    C = L1;
    //D = L2;
# ---------- end c_script_6 ----------

c_script_7 = CSharpScript(knob=wind_dir, reset=reset)  # -> A; inputs knob: Double, reset: Boolean
# ---------- c_script_7: C# ----------
    //Converting double to decimal to work with knob/dial
    decimal val = Convert.ToDecimal(knob);

    // Finding current knob/dial object name
    GH_Document ghDoc = this.GrasshopperDocument;
    IGH_Param param = Component.Params.Input[0].Sources[0];
    string name = param.NickName;
    Grasshopper.Kernel.Special.GH_DialKnob KnobDial = FindObject(ghDoc, name);


    while (val < 358)
    {
      if (val % 5 == 0)
      {
        val = KnobDial.Value;
      }
      if (val % 5 == 1)
      {
        val = KnobDial.Value - 1;
      }
      if (val % 5 == 2)
      {
        val = KnobDial.Value - 2;
      }
      if (val % 5 == 3)
      {
        val = KnobDial.Value + 2;
      }
      if (val % 5 == 4)
      {
        val = KnobDial.Value + 1;
      }
      break;
    }
    if (val  == 358 | val == 359 )
    {
      val = 0;
    }
   
    

    A = val;
    //val = KnobDial.Value;


    // if (val < KnobDial.Minimum){
    //  KnobDial.Value = KnobDial.Value - KnobDial.Minimum;
    //  KnobDial.ExpireSolution(true);
    // }
    //if (val > KnobDial.Maximum){
    //  KnobDial.Value = KnobDial.Value - KnobDial.Maximum;
    //  KnobDial.ExpireSolution(true);
    //}
    if (reset){
      KnobDial.Value = 0;
      KnobDial.ExpireSolution(true);
    }
    // KnobDial.ExpireSolution(false);
# ---------- c_script_7: C# additional code ----------
  public Grasshopper.Kernel.Special.GH_DialKnob FindObject(GH_Document doc, string name)
  {
    foreach (IGH_DocumentObject obj in doc.Objects)
    {
      if (!obj.NickName.Equals(name, StringComparison.Ordinal))
        continue;

      Grasshopper.Kernel.Special.GH_DialKnob knob =
        obj as Grasshopper.Kernel.Special.GH_DialKnob;
      if (knob != null)
        return knob;
    }

    return null;
  }
# ---------- end c_script_7 ----------
panel_17 = Panel(c_script_7)
# Link to wind direction
panel_18 = Panel("5")
division_3 = Division(A=panel_17, B=panel_18)
facen = FaceNormals(Mesh=c_script_6.A)  # -> Centers, Normals
rad_2 = Radians(Degrees=panel_17)
addition = Addition(A=division_3, B="36")
cos = Cosine(Value=rad_2)
sin = Sine(Value=rad_2)
neg_2 = Negative(Value=addition)
item_5 = ListItem(List=facen.Centers, Index=neg_2, Wrap=True)
vec = VectorXYZ(XComponent=sin, YComponent=cos, ZComponent=0)  # -> Vector, Length
pt_2 = Point(item_5)
addition_2 = Addition(A=pt_2, B=vec.Vector)
division_4 = Division(A=multiplication, B="2")
vec2pt = Vector2Pt(PointA=pt_2, PointB=addition_2, Unitize=False)  # -> Vector, Length
vec_2 = VectorXYZ(XComponent=0, YComponent=0, ZComponent=division_4)  # -> Vector, Length
move_5 = Move(Geometry=vec.Vector, Motion=vec_2.Vector)  # -> Geometry, Transform
scale = Scale(Geometry=vec2pt.Vector, Center=Point(0, 0, 0), Factor=Slider(18.6, range=0..20))  # -> Geometry, Transform
pt_3 = Point(vec.Vector)
dprod = DotProduct(VectorA=vec2pt.Vector, VectorB=facen.Normals, Unitize=True)
xprod = CrossProduct(VectorA=scale.Geometry, VectorB=facen.Normals, Unitize=True)  # -> Vector, Length
swatch = ColourSwatch(SwatchColor=RGB(62, 157, 189))
division_5 = Division(A=dprod, B=xprod.Length)
vdisex_2 = VectorDisplayEx(Point=facen.Centers, Vector=scale.Geometry, Colour=swatch, Width=2)
acos = ArcCosine(Value=division_5)
deg = Degrees(Radians=acos)
round = Round(Number=deg)  # -> Nearest, Floor, Ceiling
vdisex_3 = VectorDisplayEx(Point=facen.Centers, Vector=facen.Normals, Colour=swatch, Width=2)
panel_19 = Panel(round.Nearest)
smaller = SmallerThan(FirstNumber=panel_19, SecondNumber="90")  # -> SmallerThan, OrEqualTo
panel_20 = Panel(smaller.OrEqualTo)

mesh_2 = Mesh(c_script_3.A)  # disabled
points_8 = PointList(Points=c_script_5.B, Size=number_slider_3)  # disabled
points_9 = PointList(Points=c_script_5.A, Size=number_slider_3)  # disabled
panel_21 = Panel(c_script_6.C)
panel_22 = Panel("""72
73
145
144
73
74
146
145
74
75
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""")
panel_23 = Panel("""505
506
578
577
506
507
579
578
507
508
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""")
# faces
# box
# box
c_script_8 = CSharpScript(inputGroundVertices=panel_22, inputTopVertices=panel_23, fullList=fulllist.A)  # -> out, A, B, C, D, E; inputs inputGroundVertices: list of Int32, inputTopVertices: list of Int32, fullList: list of Point3d
# ---------- c_script_8: C# ----------
    List<Point3d> cutList = new List<Point3d>();
    List<String> groundBoxList = new List<String>();
    List<String> topBoxList = new List<String>();


    Mesh m = new Mesh();
    //Mesh n = new Mesh();
    //List<String> L1 = new List<String>();
    // List<String> L2 = new List<String>();
    //B = input;

    //cutList = fullList.GetRange(24, 122);
    //cutList.RemoveRange(49, 24);


    foreach(Point3d xx in fullList) m.Vertices.Add(xx);





    for (int i = 0;i < inputTopVertices.Count - 3; i = i + 4){
      m.Faces.AddFace(inputGroundVertices[i], inputGroundVertices[i + 1], inputGroundVertices[i + 2], inputGroundVertices[i + 3]);
    }
    for (int i = 0;i < inputTopVertices.Count - 3; i = i + 4){
      m.Faces.AddFace(inputTopVertices[i], inputTopVertices[i + 1], inputTopVertices[i + 2], inputTopVertices[i + 3]);
    }

    //groundBoxList.Add("ground\n {\n type wall;\n faces\n (");
    for(int i = 0; i < m.Faces.Count() / 2;i++){
      groundBoxList.Add("(" + m.Faces[i].A.ToString() + " " + m.Faces[i].B.ToString() + " " + m.Faces[i].C.ToString() + " " + m.Faces[i].D.ToString() + ")");
    }
    groundBoxList.Add(" \n  );\n}");

    //topBoxList.Add("top\n {\n type symmetry;\n faces\n (");
    for(int i = m.Faces.Count() / 2; i < m.Faces.Count()  ;i++){
      topBoxList.Add("(" + m.Faces[i].A.ToString() + " " + m.Faces[i].B.ToString() + " " + m.Faces[i].C.ToString() + " " + m.Faces[i].D.ToString() + ")");
    }
    topBoxList.Add(" \n  );\n}");


    A = m;
    B = m.Faces.Count();
    C = groundBoxList;
    D = topBoxList;
# ---------- end c_script_8 ----------
# blocks
# box
c_script_9 = CSharpScript(inputGroundFaces=panel_22, inputTopFaces=panel_23, divisionsZ=number_slider_4)  # -> out, A, B, C, D; inputs inputGroundFaces: list of Int32, inputTopFaces: list of Int32
# ---------- c_script_9: C# ----------
    List<int> m = new List<Int32>();
    List<string> L1 = new List<String>();


    for (int i = 0;i < inputGroundFaces.Count - 3; i = i + 4){
      bool continueLoop = true;
      m.Add(inputGroundFaces[i]);
      m.Add(inputGroundFaces[i + 1]);
      m.Add(inputGroundFaces[i + 2]);
      m.Add(inputGroundFaces[i + 3]);
      while (continueLoop){
        m.Add(inputTopFaces[i]);
        m.Add(inputTopFaces[i + 1]);
        m.Add(inputTopFaces[i + 2]);
        m.Add(inputTopFaces[i + 3]);
        continueLoop = false;
      }
    }


    for(int i = 0; i < inputGroundFaces.Count + inputTopFaces.Count ;i = i + 8){
      L1.Add("hex (" + m[i].ToString() + " " + m[i + 1].ToString() + " " + m[i + 2].ToString() + " " + m[i + 3].ToString() + " " + m[i + 4].ToString() + " " + m[i + 5].ToString() + " " + m[i + 6].ToString() + " " + m[i + 7].ToString() + ") (1 1 " + divisionsZ + ") simpleGrading (1 1 1)  ");
    }



    A = m;
    B = L1;
# ---------- end c_script_9 ----------
panel_24 = Panel(c_script_8.C)
panel_25 = Panel(c_script_8.D)
panel_26 = Panel(c_script_9.B)
panel_27 = Panel("""/*--------------------------------*- C++ -*----------------------------------*\
| =========                 |                                                 |
| \\      /  F ield         | OpenFOAM: The Open Source CFD Toolbox           |
|  \\    /   O peration     | Version:  2.1.0                                  |
|   \\  /    A nd           | Web:      http://www.OpenFOAM.com               |
|    \\/     M anipulation  |                                                 |
\*---------------------------------------------------------------------------*/

FoamFile
{
    version     2.0;
    format      ascii;
    class       dictionary;
    object      blockMeshDict;
}
// * * * * * * * * * * * * * * * * * * * * * * * * * * * * * * * * * * * * * //
 
convertToMeters 1;
 



//
vertices        
(""")
panel_28 = Panel("""); 

blocks          
(""")
panel_29 = Panel(""");
 
 edges           
 (

 );
boundary
(""")
panel_30 = Panel("""    );

 
mergePatchPairs 
(
);""")
# Concetenate everything
c_script_10 = CSharpScript(
    x=panel_27,
    y=panel_11,
    z=panel_28,
    u=panel_14,
    v=panel_26,
    w=panel_29,
    xx=panel_21,
    xz=panel_12,
    xv=panel_24,
    xu=panel_13,
    xw=panel_25,
    xy=panel_30)  # -> out, A; inputs x: list of String, y: list of String, z: list of String, u: list of String, v: list of String, w: list of String, xx: list of String, xz: list of String, xv: list of String, xu: list of String, xw: list of String, xy: list of String
# ---------- c_script_10: C# ----------
    List<String> L = new List<String>();
    List<String> L2 = new List<String>();



    L = x.Concat(y).Concat(z).Concat(u).Concat(v).Concat(w).Concat(xx).Concat(xz).Concat(xv).Concat(xu).Concat(xw).Concat(xy).ToList();
    A = L;
# ---------- end c_script_10 ----------
panel_31 = Panel(c_script_10.A)
