# Grasshopper definition 10_IndoorExample.ghx (Grasshopper 1.0.7)
# plug-ins: Eddy3D

geo = Geometry(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)
geo_2 = Geometry(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)
geo_3 = Geometry(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)
facen = FaceNormals(Mesh=geo_2)  # -> Centers, Normals
geo_4 = Geometry(Geo=geo, Temp=Slider(20, range=0..100))
ol = Outlet(Geo=geo_3, Vel=Vector(0, 0, 0))
il = Inlet(Geo=geo_2, Vel=facen.Normals, Temp=Slider(20, range=0..100))
idom = IndoorDomain(Geo=geo_4, Inlet=il, Outlet=ol, Directory="C:\Temp\EddyProject", CellSize=1)
