# Grasshopper definition 4_AnnualWindAnalysis.ghx (Grasshopper 1.0.8)
# plug-ins: RhinoCodePluginGH, Eddy3D

# C:\Users\pkastner\Documents\GitHub\Sp24-Microclimate\tests\epw\USA_MA_Boston-Logan.Intl.AP.725090_TMY3.epw
boolean_toggle = BooleanToggle(True)
panel = Panel("0")
panel_2 = Panel("""5
9""")
extrusion = Extrusion(<extrusion referenced from the Rhino model>)
c_script = CSharpScript()  # -> out, a
# ---------- c_script: C# ----------
// Grasshopper Script Instance
#region Usings
using System;
using System.Linq;
using System.Collections;
using System.Collections.Generic;
using System.Drawing;

using Rhino;
using Rhino.Geometry;

using Grasshopper;
using Grasshopper.Kernel;
using Grasshopper.Kernel.Data;
using Grasshopper.Kernel.Types;
#endregion

public class Script_Instance : GH_ScriptInstance
{
    #region Notes
    /* 
      Members:
        RhinoDoc RhinoDocument
        GH_Document GrasshopperDocument
        IGH_Component Component
        int Iteration

      Methods (Virtual & overridable):
        Print(string text)
        Print(string format, params object[] args)
        Reflect(object obj)
        Reflect(object obj, string method_name)
    */
    #endregion

    private void RunScript(object x, object y, ref object a)
    {
          var point0 = new Rhino.Geometry.Point3d(0, 0, 0);
  var point1 = new Rhino.Geometry.Point3d(20, 0, 0);
  var point2 = new Rhino.Geometry.Point3d(0, 20, 0);
  var point3 = new Rhino.Geometry.Point3d(20, 20, 0);
  var point4 = new Rhino.Geometry.Point3d(0, 0, 40);
  var point5 = new Rhino.Geometry.Point3d(20, 0, 40);
  var point6 = new Rhino.Geometry.Point3d(0, 20, 40);
  var point7 = new Rhino.Geometry.Point3d(20, 20, 40);
  Rhino.Geometry.Box box1 = new Rhino.Geometry.Box(Rhino.Geometry.Plane.WorldXY, new List<Rhino.Geometry.Point3d>() { point0, point1, point2, point3, point4, point5, point6, point7 });
  Rhino.Geometry.MeshingParameters mp = new Rhino.Geometry.MeshingParameters();
  var m = Mesh.CreateFromBrep(box1.ToBrep(), mp);

  Rhino.Geometry.Mesh mm = new Rhino.Geometry.Mesh();

  foreach (Rhino.Geometry.Mesh im in m)
  {
      mm.Append(im);
  }

  a = mm;
    }
}
# ---------- end c_script ----------

# ----
# 1. Geometry &
# Boundary Conditions
panel_3 = Panel("""0
45
90
135
180
225
270
315""")
geo = Geometry(c_script.a)

brep = Brep(c_script.a)

# ----
# 3. Mesh & Simulation
panel_4 = Panel("C:\Eddy3D-Cases\4_AnnualWindAnalysis_R8")

# ----
# 0. Download Weather
panel_5 = Panel("https://energyplus-weather.s3.amazonaws.com/asia_wmo_region_2/IND/IND_Ahmedabad.426470_IWEC/IND_Ahmedabad.426470_IWEC.epw")
downloadepw = CSharpScript(epwURL=panel_5, folder=panel_4, download=boolean_toggle)  # -> path; inputs epwURL: String, folder: String, download: Boolean
# ---------- downloadepw: C# usings ----------
using System.Net;
using System.IO;
using System.Text;
# ---------- downloadepw: C# ----------
    if(!Directory.Exists(folder)){  Directory.CreateDirectory(folder);}

    if (download == true){

      DownLoadFile(epwURL, folder + "\\weather.epw");



    }

    path = folder + "\\weather.epw";
# ---------- downloadepw: C# additional code ----------
  public static void DownLoadFile(string URL, string FilePath)
  {
    WebClient webClient = new WebClient();
    webClient.DownloadFile(URL, FilePath);
  }
# ---------- end downloadepw ----------

abl_flow = ABLFlow(WindDirections=panel_3, Epw=downloadepw)
rset = RunSettings(
    NumberOfIterations="150",
    WriteInterval=20,
    NumberOfTimestepsToKeep=3,
    TurbulenceModel=2,
    RelaxationFactors=2,
    SolutionAndAlgorithmControl=1,
    PotentialFoamInitialization=False,
    AgeOfAir=True,
    NumberOfCPUs="2",
    OperatingSystem=0)
cluster = Cluster_2(mesh=geo)

# ----
# 6. Clean
button = Button()
clean = Clean(Directory=panel_4, Mode=2, Run=button)

# ----
# 2. Simulation Domain
number_slider = Slider(40, range=0..1000)

domaincyl = CylindricalDomain(
    Geometry=geo,
    BoundaryCondition=abl_flow,
    BlockSize="15",
    SizeOfInnerRectangle=number_slider,
    SizeOfOuterRadius=Slider(519, range=0..1000),
    Height=Slider(80, range=0..1000))  # -> Domain, Mesh
mesh = Mesh(domaincyl.Mesh)
demesh = DeconstructMesh(Mesh=mesh)  # -> Vertices, Faces, Colours, Normals

cellsize = CellSize(SimulationDomain=domaincyl.Domain, BlockSize="15", DesiredCellSize=Slider(2, range=0..10))  # -> Accuracy, Accuracy1

points = PointList(Points=demesh.Vertices)
mset = MeshSettings(
    AccBuilding=cellsize.Accuracy,
    AccFeatures=cellsize.Accuracy1,
    AccBBox=0,
    AccGround=cellsize.Accuracy,
    MiscSettings=1,
    NumberOfLayers=4,
    Mode=1)
simulation = Simulation(
    SimulationDomain=domaincyl.Domain,
    WorkingDirectory=panel_4,
    MeshSettings=mset,
    RunSettings=rset,
    RunMeshing=Button(),
    MakeTrees=False,
    RunSimulation=Button(),
    runWithBlueCFD=True)
residuals = VisualizeResiduals(Result=simulation, X="0", Y=":", Version=0, Run=Button(), visResiduals=True)
slurm_runner = SLURMRunner(
    Result=simulation,
    ChargeAccount="gts-pkastner3",
    NotificationEmail="patrick.kastner@gatech.edu",
    MemoryPerCPU="10",
    JobDuration="10",
    OpenFOAMLoadCommand="module load openfoam-org/8-mva2-off3dy")

# ----
# 4. Probing points & probing
number_slider_2 = Slider(5, range=1..50)
brep_2 = Brep(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)
meshplane = MeshPlane(brep=brep_2, number=number_slider_2, B=geo)  # -> L, faces, mesh

probing = Probing(BuildingMesh=cluster, Points=meshplane.mesh, ConvertQuadsToTriangles_2=True)
demesh_2 = DeconstructMesh(Mesh=probing)  # -> Vertices, Faces, Colours, Normals

visprobes = VisualizeProbes(Result=simulation, ProbingPoints=demesh_2.Vertices, NameOfInstance="ttt", NameOfField=0, Run_2=Button())  # -> PorbingPoints, ProbingResult

# ----
# 5. Post-processing
# 5.1. Paraview
# Multi-directional / annual wind vectors
# 5.2. Grasshopper
# Set to -1 for average of entire year (takes 30 s to compute)
dir = Slider(1, range=0..7)
vectors = Data(visprobes.ProbingResult)
points_2 = Data(visprobes.PorbingPoints)
paraview = Paraview(Result=simulation, ParaviewVersion=2, Run=Button())
choose_dir = TreeBranch(Tree=vectors, Path=dir, MaintainPaths=True)
number_slider_3 = Slider(0, range=0..10)
wind_factors = WindFactors(Result=simulation, ProbingPoints=points_2, WindVelocity=vectors, Run=Button(), Interpolation=True)  # -> WindFactorsSpatial, WindFactorsAnnual
cluster_2 = Cluster(data=choose_dir)  # -> S, E, data_3
gradient = Gradient(
    LowerLimit=cluster_2.S,
    UpperLimit=number_slider_3,
    Parameter=cluster_2.data_3,
    stops=[0.103: RGB(0, 0, 255), 0.22: RGB(0, 170, 255), 0.305: RGB(0, 255, 255), 0.398: RGB(0, 255, 188), 0.504: RGB(0, 255, 106), 0.605: RGB(91, 255, 0), 0.699: RGB(184, 255, 0), 0.799: RGB(255, 255, 0), 0.898: RGB(255, 170, 0)])
panel_6 = Panel("-1")
dedata = DeconstructDataObjects(Data=wind_factors.WindFactorsAnnual, Select=number_slider_3)
flip = FlipMatrix(Data=dedata)
vdisex = VectorDisplayEx(Point=points_2, Vector=choose_dir, Colour=gradient, Width=Slider(3, range=0..10))  # disabled
avr = Average(Input=flip)  # -> flatten(ArithmeticMean)
cluster_3 = Cluster(data=avr)  # -> S, E, data_3
cluster_4 = Cluster_4(C=points_2, T=Vector(0, 0, 10))
gradient_2 = Gradient(
    LowerLimit=cluster_3.S,
    UpperLimit=cluster_3.E,
    Parameter=cluster_3.data_3,
    stops=[0.103: RGB(0, 0, 255), 0.22: RGB(0, 170, 255), 0.305: RGB(0, 255, 255), 0.398: RGB(0, 255, 188), 0.504: RGB(0, 255, 106), 0.605: RGB(91, 255, 0), 0.699: RGB(184, 255, 0), 0.799: RGB(255, 255, 0), 0.898: RGB(255, 170, 0)])
preview = CustomPreview(Geometry=cluster_4, Material=gradient_2)

pedestrian_wind_comfort = PedestrianWindComfort(
    WindFactorsSpatial=wind_factors.WindFactorsSpatial,
    WindFactorsAnnual=wind_factors.WindFactorsAnnual,
    WindComfortMetric=1,
    Weibull_Fit=True)  # -> WindComfortRank, WindComfortClassLetter, WindComfortClass

# ----
# Wind Comfort Metrics
vec = Vector(Vector(-271, -230, 0))
cluster_5 = Cluster_4(C=points_2, T=Vector(0, 0, 10))
cluster_6 = Cluster_4(C=points_2, T=Vector(0, 0, 10))
pedestrian_wind_comfort_2 = PedestrianWindComfort(
    WindFactorsSpatial=wind_factors.WindFactorsSpatial,
    WindFactorsAnnual=wind_factors.WindFactorsAnnual,
    WindComfortMetric=1,
    Weibull_Fit=True)  # -> WindComfortRank, WindComfortClassLetter, WindComfortClass
move = Move(Geometry=cluster_5, Motion=vec)  # -> flatten(Geometry), Transform
move_2 = Move(Geometry=geo, Motion=vec)  # -> flatten(Geometry), Transform
move_3 = Move(Geometry=cluster_6, Motion=Vector(-280.6944615, 0, 0))  # -> flatten(Geometry), Transform
move_4 = Move(Geometry=geo, Motion=Vector(-280.6944615, 0, 0))  # -> flatten(Geometry), Transform
area = Area(Geometry=move.Geometry)  # -> Area, Centroid
area_2 = Area(Geometry=move_3.Geometry)  # -> Area, Centroid
cluster_7 = Cluster(data=pedestrian_wind_comfort.WindComfortRank)  # -> S, E, data_3
tag = TextTag(Location=area_2.Centroid, Text=pedestrian_wind_comfort.WindComfortClassLetter)
cluster_8 = Cluster(data=pedestrian_wind_comfort_2.WindComfortRank)  # -> S, E, data_3
tag_2 = TextTag(Location=area.Centroid, Text=pedestrian_wind_comfort_2.WindComfortClassLetter)
gradient_3 = Gradient(
    LowerLimit=cluster_7.S,
    UpperLimit=cluster_7.E,
    Parameter=cluster_7.data_3,
    stops=[0.103: RGB(0, 0, 255), 0.22: RGB(0, 170, 255), 0.305: RGB(0, 255, 255), 0.398: RGB(0, 255, 188), 0.504: RGB(0, 255, 106), 0.605: RGB(91, 255, 0), 0.699: RGB(184, 255, 0), 0.799: RGB(255, 255, 0), 0.898: RGB(255, 170, 0)])
gradient_4 = Gradient(
    LowerLimit=cluster_8.S,
    UpperLimit=cluster_8.E,
    Parameter=cluster_8.data_3,
    stops=[0.103: RGB(0, 0, 255), 0.22: RGB(0, 170, 255), 0.305: RGB(0, 255, 255), 0.398: RGB(0, 255, 188), 0.504: RGB(0, 255, 106), 0.605: RGB(91, 255, 0), 0.699: RGB(184, 255, 0), 0.799: RGB(255, 255, 0), 0.898: RGB(255, 170, 0)])
preview_2 = CustomPreview(Geometry=move_3.Geometry, Material=gradient_3)
preview_3 = CustomPreview(Geometry=area.Centroid, Material=gradient_4)

# ==== cluster MeshPlane
B = ClusterInput()
number = ClusterInput()
number_2 = Number(number)
settings_custom = SettingsCustom(
    StitchSeams=True,
    SimplePlanes=False,
    Refine=True,
    MinCount=16,
    MaxCount=400,
    AspectRatio=20,
    MaxDistance=0,
    MaxAngle=20,
    MinEdge=number_2,
    MaxEdge=number_2)
brep = ClusterInput()
mesh_brep = MeshBrep(Brep=brep, Settings=settings_custom)
deconstruct_mesh = DeconstructMesh(Mesh=mesh_brep)  # -> Vertices, Faces, Colours, Normals
brepsinc = PointInBreps(Brep=B, Point=deconstruct_mesh.Vertices, Strict=False)  # -> Inside, Index
not = GateNot(A=brepsinc.Inside)
cull = CullPattern(List=deconstruct_mesh.Vertices, CullPattern=not)
faces = ClusterOutput(deconstruct_mesh.Faces)
L = ClusterOutput(cull)
mesh = ClusterOutput(mesh_brep)

# ==== cluster Cluster
data = ClusterInput()
data_2 = Data(data)
data_3 = ClusterOutput(data_2)
bnd = Bounds(Numbers=data_2)
dedomain = DeconstructDomain(Domain=bnd)  # -> Start, End
S = ClusterOutput(dedomain.Start)
E = ClusterOutput(dedomain.End)

# ==== cluster Cluster_2
mesh = ClusterInput()
mesh_2 = Mesh(mesh)
mjoin = MeshJoin(Meshes=mesh_2)
M = ClusterOutput(mjoin)

# ==== cluster Cluster_4
C = ClusterInput()
cluster = Cluster_3(C=C)
T = ClusterInput()
move = Move(Geometry=cluster, Motion=T)  # -> Geometry, Transform
srf = ClusterOutput(cluster)

# ==== cluster Cluster_3
C = ClusterInput()
circle = CircleCNR(Center=C, Normal=Vector(0, 0, 1), Radius=2)
srf = Surface(circle)
srf_2 = ClusterOutput(srf)
