# Grasshopper definition testingEddyRadSim.gh (Grasshopper 1.0.7)
# plug-ins: DIVA Daylight, ClimateStudioGH, Eddy3D

panel = Panel("""void plastic PlasterFloor_70
0
0
5 0.7 0.7 0.7 0 0 """)
brep = Brep(<brep referenced from the Rhino model>)
brep_2 = Brep([<brep referenced from the Rhino model> x2])
brep_3 = Brep(<brep referenced from the Rhino model>)
custom_mesh_settings = SettingsCustom(
    StitchSeams=True,
    SimplePlanes=False,
    Refine=True,
    MinCount=16,
    MaxCount=400,
    AspectRatio=20,
    MaxDistance=0,
    MaxAngle=20,
    MinEdge="5",
    MaxEdge="5")
brep_4 = Brep(<brep referenced from the Rhino model>)
radsurf = RadiationSurface(Brep=brep, Type=1, Patch=3, Material=panel)
radsurf_2 = RadiationSurface(Brep=brep_2, Type=0, Patch=3)
radsurf_3 = RadiationSurface(Brep=brep_3, Type=3, Patch=3)
python = GhPythonScript(x=radsurf_2)  # -> out, a, b
# ---------- python: Python ----------
__author__ = "Timur"
__version__ = "2021.03.03"

import rhinoscriptsyntax as rs


a = x.HighPoly
b = x.LowPoly
# ---------- end python ----------
data = Data([radsurf, radsurf_2, radsurf_3])
sen = Sensor(Point=Point(0, 0, 0), Normal=Vector(0, 0, 1))
mesh = MeshBrep(Brep=brep_4, Settings=custom_mesh_settings)
mesh_2 = Mesh(python.b)
rad = RadSystem(
    Name="MyStudy",
    Dir="C:\Temp\Eddy 3d",
    Weather="C:\Eddy3D\Weather\USA_NY_New.York-LaGuardia.AP.725030_TMY3.epw",
    RSurf=[radsurf_2, radsurf_3, radsurf],
    Probes=[sen, mesh],
    Run=Button())  # -> RadSystem, Result
hoy = HourOfYear(Month="4", Day=21, Hour="14")  # -> HourOfYear, DayOfYear
panel_2 = Panel(hoy.HourOfYear)
therm = Thermal(
    Name="MyStudy",
    Dir="C:\Temp\Eddy3d",
    Weather="C:\Eddy3D\Weather\USA_NY_New.York-LaGuardia.AP.725030_TMY3.epw",
    System=rad.RadSystem,
    Run=Button())
python_2 = GhPythonScript(x=rad.RadSystem)  # -> out, a
# ---------- python_2: Python ----------
__author__ = "Timur"
__version__ = "2021.03.03"

import rhinoscriptsyntax as rs
import Rhino.Geometry as rg

a = x.SkyDomeForVF #rg.Mesh.CreateQuadSphere( x.SkyDomeForVF , 3)
# ---------- end python_2 ----------
python_3 = GhPythonScript(x=rad.RadSystem)  # -> out, a
# ---------- python_3: Python ----------
__author__ = "Timur"
__version__ = "2021.03.03"

import rhinoscriptsyntax as rs
import Rhino.Geometry as rg

a = x.Radio #rg.Mesh.CreateQuadSphere( x.SkyDomeForVF , 3)
# ---------- end python_3 ----------
mesh_3 = Mesh(python_2.a)
mesh_4 = Mesh(python_3.a)
lrad = LoadRadiation(Path=rad.Result, Hour=panel_2, Load=Toggle(True))  # -> Result, Meshes, Probes, Hour
c_script = CSharpScript(x=lrad.Result, si="0", Reference="C:\Users\Timur\Dropbox\_CSHARP_PROJECTS\Eddy3d\Build\Dotfuscated\EddyLib.dll")  # -> out, A, B; inputs si: Int32
# ---------- c_script: C# usings ----------
using EddyLib.Radiation;
# ---------- c_script: C# ----------
    RadiationSimulationResultProto res = (RadiationSimulationResultProto) x;

    var list = new List<float> ();

    list.AddRange(res.Probes[res.Probes.Count - 1].SolarGain_dMRT);


    A = list;
    B = res.Probes[res.Probes.Count - 1].Point.Value;
# ---------- end c_script ----------
inspectprobe = CSharpScript(x=lrad.Probes, si="0", Reference="C:\Users\Timur\Dropbox\_CSHARP_PROJECTS\Eddy3d\Build\Dotfuscated\EddyLib.dll")  # -> out, A, B, C; inputs x: list, si: Int32
# ---------- inspectprobe: C# usings ----------
using EddyLib.Radiation;
using System.Linq;
# ---------- inspectprobe: C# ----------
    EddyLib.Radiation.RProbe res = (EddyLib.Radiation.RProbe) x[si];

    var keylist = new List<string> ();

    var list = new List<double> ();

    list.AddRange(res.VFtoMaterial.Values.ToList());

    keylist.AddRange(res.VFtoMaterial.Keys.ToList());

    A = res.Point.Value;
    B = keylist;
    C = list;
# ---------- end inspectprobe ----------
c_script_2 = CSharpScript(x=lrad.Result, si="0", Reference="C:\Users\Timur\Dropbox\_CSHARP_PROJECTS\Eddy3d\Build\Dotfuscated\EddyLib.dll")  # -> out, A; inputs si: Int32
# ---------- c_script_2: C# ----------
    RadiationSimulationResultProto res = (RadiationSimulationResultProto) x;

    var list = new List<float> ();
    list.AddRange(res.Probes[si].DirRad);


    A = list;
# ---------- end c_script_2 ----------

# ----
# comparing DDS simulation to weather file total horizontal radiation
weather = Weather(
    Location="USA_NY_New.York-LaGuardia.AP.725030_TMY3",
    Input_0_Hidden=False,
    Input_0_Name="Location",
    Output_0_Hidden=False,
    Output_0_Name="Location",
    Output_10_Hidden=False,
    Output_10_Name="DiffuseHorizontalRadiation",
    Output_11_Hidden=False,
    Output_11_Name="GlobalHorizontalRadiation",
    Output_12_Hidden=True,
    Output_12_Name="SkyCover",
    Output_13_Hidden=True,
    Output_13_Name="Precipitation",
    Output_14_Hidden=True,
    Output_14_Name="Elev",
    Output_15_Hidden=True,
    Output_15_Name="Azimuth",
    Output_16_Hidden=True,
    Output_16_Name="Vector",
    Output_17_Hidden=True,
    Output_17_Name="Illuminance",
    Output_18_Hidden=True,
    Output_18_Name="DateTime",
    Output_19_Hidden=True,
    Output_19_Name="DryBulbAverages",
    Output_1_Hidden=True,
    Output_1_Name="Latitude",
    Output_20_Hidden=True,
    Output_20_Name="DewPointAverages",
    Output_21_Hidden=True,
    Output_21_Name="DryBulbMinima"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)  # -> Location, DryBulbTemp, RelativeHumidity, DirectNormalRadiation, DiffuseHorizontalRadiation, GlobalHorizontalRadiation
c_script_3 = CSharpScript(x=lrad.Result, si="0", Reference="C:\Users\Timur\Dropbox\_CSHARP_PROJECTS\Eddy3d\Build\Dotfuscated\EddyLib.dll")  # -> out, A; inputs si: Int32
# ---------- c_script_3: C# ----------
    RadiationSimulationResultProto res = (RadiationSimulationResultProto) x;

    var list = new List<float> ();
    list.AddRange(res.Probes[si].TotalRad);

    A = list;
# ---------- end c_script_3 ----------
entwine = Entwine(
    Branch00=weather.GlobalHorizontalRadiation,
    Branch01=c_script_3.A,
    Branch02=c_script_2.A,
    Branch03=c_script.A,
    FlattenInputs=True)
panel_3 = Panel("""WeatherData
Simulation
Simulation Diffuse """)
cluster = Cluster_2(doy=Slider(3, range=1..365))
subset = SubList(List=entwine, Domain=cluster, Wrap=True)  # -> List, Index
cluster_2 = Cluster(L=panel_3)  # -> C, R
xyplot = XYPlot(
    Type=0,
    Width=550,
    Height=450,
    Title="Radiation [W/m2]",
    X_rot=0,
    Y_data=subset.List,
    Colors=cluster_2.C,
    Names=panel_3,
    Show_xgrid=False,
    Show_ygrid=True,
    Legend=0)

panel_4 = Panel([inspectprobe.B, inspectprobe.C])
bnd = Bounds(Numbers=lrad.Hour)
dedomain = DeconstructDomain(Domain=bnd)  # -> Start, End
gradient = GetCSGradient(Steps=0, UnitSystem=4)
bnd_2 = Bounds(Numbers=c_script.A)
falsecolor = ConstructCSFalsecolor(GradientS=gradient, DomainS=bnd_2, UnitSystem=4)
gradient_2 = Gradient(
    LowerLimit=0,
    UpperLimit=dedomain.End,
    Parameter=lrad.Hour,
    stops=[0: RGB(0, 0, 255), 0.5: RGB(255, 255, 0), 1: RGB(255, 0, 0)])
panel_5 = Panel(bnd)
plothr = CSPlotHourlyData(
    Data=c_script.A,
    Falsecolor=falsecolor,
    Input_0_Hidden=False,
    Input_0_Name="Data",
    Input_1_Hidden=False,
    Input_1_Name="Falsecolor",
    Input_2_Hidden=False,
    Input_2_Name="File Path",
    UnitSystem=4)
mcol = MeshColours(Mesh=lrad.Meshes, Colours=gradient_2)
X = UnitX(Factor="100")
move = Move(Geometry=mcol, Motion=X)  # -> Geometry, Transform

# ==== cluster Cluster
L = ClusterInput()
lng = ListLength(List=L)
series = Series(Start=0, Step=1, Count=lng)
gradient = Gradient(
    LowerLimit=0,
    UpperLimit=lng,
    Parameter=series,
    stops=[0: RGB(243, 57, 0), 0.1: RGB(236, 27, 60), 0.2: RGB(210, 0, 118), 0.3: RGB(103, 0, 120), 0.4: RGB(39, 72, 161), 0.5: RGB(1, 192, 229), 0.6: RGB(18, 178, 90), 0.7: RGB(79, 186, 8), 0.8: RGB(220, 237, 32), 0.9: RGB(247, 159, 20), 1: RGB(243, 57, 0)])
concat = Concatenate(FragmentA="Panel ", FragmentB=series)
C = ClusterOutput(gradient)
R = ClusterOutput(concat)

# ==== cluster Cluster_2
doy = ClusterInput()
md = MonthAndDay(DayOfYearIndex=doy)  # -> Month, Day
hoy = HourOfYear(Month=md.Month, Day=md.Day, Hour=1)
multiplication = Multiplication(A="24", B="7")
addition = Addition(A=hoy, B=multiplication)
dom = ConstructDomain(DomainStart=hoy, DomainEnd=addition)
I = ClusterOutput(dom)
